# Grasshopper definition Cut Sheets.gh (Grasshopper 1.0.7)
# plug-ins: OpenNest, NGon, Pufferfish

# ---- group: Set Geo
# Start Here!
brep = Brep([<brep referenced from the Rhino model> x5])

# ---- group: Back/Front
boolean_toggle = BooleanToggle(True)

# ---- group: Set Sheet Size
material = Curve(<curve referenced from the Rhino model>)

# ---- group: 3D Label Prefix
panel = Panel("C")

# ----
list_length = ListLength(List=brep)
debrep = DeconstructBrep(Brep=brep)  # -> Faces, Edges, Vertices
srf = Surface(debrep.Faces)
lng = ListLength(List=srf)
area = Area(Geometry=srf)  # -> Area, Centroid
sort = SortList(Keys=area.Area, ValuesA=srf)  # -> Keys, ValuesA
rev = ReverseList(List=sort.ValuesA)
item = ListItem(List=sort.ValuesA, Index=lng, Wrap=True)
item_2 = ListItem(List=rev, Index=lng, Wrap=True)  # -> Item, Item1, Item2
deconstruct_brep = DeconstructBrep(Brep=item)  # -> Faces, Edges, Vertices
length = Length(Curve=deconstruct_brep.Edges)
surface = Surface(flatten(item_2.Item))
sort_list = SortList(Keys=length, ValuesValuesA=deconstruct_brep.Edges)  # -> Keys, ValuesValuesA
list_item = ListItem(List=sort_list.ValuesValuesA, Index=Slider(0, range=0..100), Wrap=True)  # -> flatten(Item)
list_item_2 = ListItem(List=sort_list.ValuesValuesA, Index=Slider(2, range=0..100), Wrap=True)  # -> flatten(Item)
area_2 = Area(Geometry=surface)  # -> Area, flatten(Centroid)
end_points = EndPoints(Curve=list_item)  # -> Start, End
end_points_2 = EndPoints(Curve=list_item_2)  # -> Start, End
is_planar = IsPlanar(Surface=surface, Interior=True)  # -> Planar, Plane
vector_2pt = Vector2Pt(PointA=end_points.Start, PointB=end_points.End, Unitize=False)  # -> Vector, Length
vector_2pt_2 = Vector2Pt(PointA=end_points_2.Start, PointB=end_points_2.End, Unitize=False)  # -> Vector, Length
unit_x = UnitX(Factor=1)
deconstruct_plane = DeconstructPlane(Plane=is_planar.Plane)  # -> Origin, XAxis, YAxis, ZAxis
angle = Angle(VectorA=vector_2pt.Vector, VectorB=unit_x)  # -> Angle, Reflex
degrees = Degrees(Radians=angle.Angle)
panel_2 = Panel("""0
90
-90
180
-180""")
subtraction = Subtraction(A=degrees, B=90)  # -> flatten(Result)
ghpython_script = GhPythonScript(u=deconstruct_plane.XAxis, v=deconstruct_plane.YAxis, w=deconstruct_plane.ZAxis)  # -> out, a, b, c; inputs x: list, y: list, z: list
# ---------- ghpython_script: Python ----------
__author__ = "Hannah"
__version__ = "2024.01.30"

import rhinoscriptsyntax as rs

print (u[0])

def fixpoint(P):
  axes = [0,1,2]
  for axis in axes:
    if 0.0 <= P[axis] and P[axis] < 2.0/6.0:
      P[axis] = 0
    if 2.0 / 6.0 < P[axis] and P[axis] <= 1:
      P[axis] = 1
    if -2.0 / 6.0 < P[axis] and P[axis] <= 0:
      P[axis] = 0
    if -1 <= P[axis] and P[axis] < -2.0 / 6.0:
      P[axis] = -1

a = [u[0],u[1],u[2]]
fixpoint(a)
b = [v[0],v[1],v[2]]
fixpoint(b)
c = [w[0],w[1],w[2]]
fixpoint(c)
# ---------- end ghpython_script ----------
list_length_2 = ListLength(List=subtraction)
flip_matrix = FlipMatrix(Data=ghpython_script.b)
flip_matrix_2 = FlipMatrix(Data=ghpython_script.a)
flip_matrix_3 = FlipMatrix(Data=ghpython_script.c)
item_index = ItemIndex(List=subtraction, Item=panel_2)
series = Series(Start=0, Step=1, Count=list_length_2)
plane_normal = PlaneNormal(Origin=Point(0, 0, 0), ZAxis=Vector(0, 0, 1))
explode_tree = ExplodeTree(Data=flip_matrix)  # -> Branch0, Branch1, Branch2
explode_tree_2 = ExplodeTree(Data=flip_matrix_3)  # -> Branch0, Branch1, Branch2
explode_tree_3 = ExplodeTree(Data=flip_matrix_2)  # -> Branch0, Branch1, Branch2
vector_xyz = VectorXYZ(XComponent=explode_tree_3.Branch0, YComponent=explode_tree_3.Branch1, ZComponent=explode_tree_3.Branch2)  # -> Vector, Length
vector_xyz_2 = VectorXYZ(XComponent=explode_tree.Branch0, YComponent=explode_tree.Branch1, ZComponent=explode_tree.Branch2)  # -> Vector, Length
vector_xyz_3 = VectorXYZ(XComponent=explode_tree_2.Branch0, YComponent=explode_tree_2.Branch1, ZComponent=explode_tree_2.Branch2)  # -> Vector, Length
cull_index = CullIndex(List=series, Indices=item_index, Wrap=True)
replace_items = ReplaceItems(List=subtraction, Indices=cull_index, Wrap=True)
plane_normal_2 = PlaneNormal(Origin=deconstruct_plane.Origin, ZAxis=vector_xyz_3.Vector)
construct_plane = ConstructPlane(Origin=Point(0, 0, 0), XAxis=vector_xyz.Vector, YAxis=vector_xyz_2.Vector)
list_item_3 = ListItem(List=surface, Index=replace_items, Wrap=True)
orient = Orient(Geometry=surface, Source=is_planar.Plane, Target=plane_normal_2)  # -> Geometry, Transform
flip_matrix_4 = FlipMatrix(Data=orient.Geometry)
list_item_4 = ListItem(List=flip_matrix_4, Index=0, Wrap=True)  # -> flatten(Item)
area_3 = Area(Geometry=list_item_4)  # -> Area, Centroid
move_to_point = MoveToPoint(Geometry=list_item_4, PointA=area_3.Centroid, PointB=area_2.Centroid)  # -> Moved, Vector, Transform
surface_2 = Surface(flatten(move_to_point.Moved))
flip_matrix_5 = FlipMatrix(Data=move_to_point.Moved)
surface_3 = Surface(surface_2)
area_4 = Area(Geometry=surface_3)  # -> Area, Centroid
evaluate_surface = EvaluateSurface(Surface=surface_3, Point=area_4.Centroid)  # -> Point, Normal, UDirection, VDirection, Frame
vector = Vector(flatten(evaluate_surface.Normal))

plane_normal_3 = PlaneNormal(Origin=Point(0, 0, 0), ZAxis=Vector(0, 0, 1))
bounding_box = BoundingBox(Content=brep, Plane=plane_normal_3, UnionBox=True)  # -> Box, Box_2
deconstruct_brep_2 = DeconstructBrep(Brep=bounding_box.Box)  # -> Faces, Edges, Vertices
area_5 = Area(Geometry=deconstruct_brep_2.Faces)  # -> Area, Centroid
evaluate_surface_2 = EvaluateSurface(Surface=deconstruct_brep_2.Faces, Point=area_5.Centroid)  # -> Point, Normal, UDirection, VDirection, Frame
vector_display = VectorDisplay(Anchor=area_5.Centroid, Vector=evaluate_surface_2.Normal)

unit_z = UnitZ(Factor=1)
unit_x_2 = UnitX(Factor=1)
unit_y = UnitY(Factor=1)
dot_product = DotProduct(VectorA=vector, VectorB=unit_x_2, Unitize=False)
dot_product_2 = DotProduct(VectorA=vector, VectorB=unit_z, Unitize=False)
dot_product_3 = DotProduct(VectorA=vector, VectorB=unit_y, Unitize=False)
member_index = MemberIndex(Set=dot_product, Member=[Slider(1, range=0..100), Slider(-1, range=-1..1)])  # -> Index, Count
member_index_2 = MemberIndex(Set=dot_product_3, Member=[Slider(1, range=0..100), Slider(-1, range=-1..1)])  # -> Index, Count
member_index_3 = MemberIndex(Set=dot_product_2, Member=[Slider(1, range=0..100), Slider(-1, range=-1..1)])  # -> Index, Count

# ---- group: X
# IF you don't have any pieces in a particualr plane the wires might turn orange here. Don't be alarmed as long as everything looks correct in Rhino
list_item_5 = ListItem(List=surface_3, Index=member_index.Index, Wrap=True)  # -> flatten(Item)

# ---- group: Y
list_item_6 = ListItem(List=surface_3, Index=member_index_2.Index, Wrap=True)  # -> flatten(Item)

# ---- group: Z
list_item_7 = ListItem(List=surface_3, Index=member_index_3.Index, Wrap=True)  # -> flatten(Item)

# ----
unit_z_2 = UnitZ(Factor=1)
number_slider = Slider(1, range=0..100)
unit_y_2 = UnitY(Factor=1)
dot_product_4 = DotProduct(VectorA=evaluate_surface_2.Normal, VectorB=unit_z_2, Unitize=False)
unit_x_3 = UnitX(Factor=1)
negative = Negative(Value=number_slider)
dot_product_5 = DotProduct(VectorA=evaluate_surface_2.Normal, VectorB=unit_y_2, Unitize=False)
member_index_4 = MemberIndex(Set=dot_product_4, Member=[number_slider, negative])  # -> Index, Count
dot_product_6 = DotProduct(VectorA=evaluate_surface_2.Normal, VectorB=unit_x_3, Unitize=False)
member_index_5 = MemberIndex(Set=dot_product_5, Member=[number_slider, negative])  # -> Index, Count
list_item_8 = ListItem(List=deconstruct_brep_2.Faces, Index=member_index_4.Index, Wrap=True)
member_index_6 = MemberIndex(Set=dot_product_6, Member=[number_slider, negative])  # -> Index, Count
list_item_9 = ListItem(List=deconstruct_brep_2.Faces, Index=member_index_5.Index, Wrap=True)
area_6 = Area(Geometry=list_item_8)  # -> Area, Centroid
list_item_10 = ListItem(List=flatten(list_item_8), Index=0, Wrap=True)  # -> Item, Item1
list_item_11 = ListItem(List=deconstruct_brep_2.Faces, Index=member_index_6.Index, Wrap=True)
list_item_12 = ListItem(List=flatten(list_item_9), Index=0, Wrap=True)  # -> Item, Item1
list_item_13 = ListItem(List=evaluate_surface_2.Normal, Index=member_index_5.Index, Wrap=True)
area_7 = Area(Geometry=list_item_9)  # -> Area, Centroid
area_8 = Area(Geometry=list_item_11)  # -> Area, Centroid
list_item_14 = ListItem(List=flatten(list_item_11), Index=0, Wrap=True)  # -> Item, Item1
surface_closest_point = SurfaceClosestPoint(Point=area_6.Centroid, Surface=list_item_7)  # -> Point, UVPoint, Distance
surface_closest_point_2 = SurfaceClosestPoint(Point=area_7.Centroid, Surface=list_item_6)  # -> flatten(Point), UVPoint, Distance
surface_closest_point_3 = SurfaceClosestPoint(Point=area_8.Centroid, Surface=list_item_5)  # -> Point, UVPoint, Distance
vector_display_2 = VectorDisplay(Anchor=area_7.Centroid, Vector=list_item_13)
explode_tree_4 = ExplodeTree(Data=surface_closest_point.Distance)  # -> Branch0, Branch1
ghpython_script_2 = GhPythonScript(x=boolean_toggle, y=list_item_12.Item, z=list_item_12.Item1)  # -> out, a, b
# ---------- ghpython_script_2: Python ----------
__author__ = "Hannah"
__version__ = "2024.01.31"

import rhinoscriptsyntax as rs

if x==0:
    a=y
    b=z
else:
    a=z
    b=y
# ---------- end ghpython_script_2 ----------
explode_tree_5 = ExplodeTree(Data=surface_closest_point_3.Distance)  # -> Branch0, Branch1
explode_tree_6 = ExplodeTree(Data=surface_closest_point_2.Distance)  # -> Branch0, Branch1
ghpython_script_3 = GhPythonScript(x=explode_tree_6.Branch0, y=explode_tree_6.Branch1)  # -> out, a, b
# ---------- ghpython_script_3: Python ----------
__author__ = "Hannah"
__version__ = "2024.01.31"

import rhinoscriptsyntax as rs

if x<y:
    a=x
else:
    b=y
# ---------- end ghpython_script_3 ----------
ghpython_script_4 = GhPythonScript(x=explode_tree_4.Branch0, y=explode_tree_4.Branch1)  # -> out, a, b; same code as ghpython_script_3
ghpython_script_5 = GhPythonScript(x=boolean_toggle, y=list_item_10.Item, z=list_item_10.Item1)  # -> out, a, b; same code as ghpython_script_2
member_index_7 = MemberIndex(Set=surface_closest_point_2.Distance, Member=ghpython_script_3.b)  # -> Index, Count
ghpython_script_6 = GhPythonScript(x=explode_tree_5.Branch0, y=explode_tree_5.Branch1)  # -> out, a, b; same code as ghpython_script_3
ghpython_script_7 = GhPythonScript(x=boolean_toggle, y=list_item_14.Item, z=list_item_14.Item1)  # -> out, a, b; same code as ghpython_script_2
member_index_8 = MemberIndex(Set=surface_closest_point.Distance, Member=ghpython_script_4.b)  # -> Index, Count
member_index_9 = MemberIndex(Set=surface_closest_point_2.Distance, Member=ghpython_script_3.a)  # -> Index, Count
member_index_10 = MemberIndex(Set=surface_closest_point.Distance, Member=ghpython_script_4.a)  # -> Index, Count
list_item_15 = ListItem(List=list_item_6, Index=member_index_7.Index, Wrap=True)
member_index_11 = MemberIndex(Set=surface_closest_point_3.Distance, Member=ghpython_script_6.a)  # -> Index, Count
member_index_12 = MemberIndex(Set=surface_closest_point_3.Distance, Member=ghpython_script_6.b)  # -> Index, Count
list_item_16 = ListItem(List=list_item_6, Index=member_index_9.Index, Wrap=True)
list_item_17 = ListItem(List=list_item_7, Index=member_index_10.Index, Wrap=True)
list_item_18 = ListItem(List=list_item_7, Index=member_index_8.Index, Wrap=True)
flip = Flip(Surface=list_item_16, Guide=ghpython_script_2.a)  # -> Surface, Result
flip_2 = Flip(Surface=list_item_15, Guide=ghpython_script_2.b)  # -> Surface, Result
list_item_19 = ListItem(List=list_item_5, Index=member_index_11.Index, Wrap=True)
list_item_20 = ListItem(List=list_item_5, Index=member_index_12.Index, Wrap=True)
flip_3 = Flip(Surface=list_item_17, Guide=ghpython_script_5.a)  # -> Surface, Result
flip_4 = Flip(Surface=list_item_18, Guide=ghpython_script_5.b)  # -> Surface, Result
flip_5 = Flip(Surface=list_item_19, Guide=ghpython_script_7.a)  # -> Surface, Result
flip_6 = Flip(Surface=list_item_20, Guide=ghpython_script_7.b)  # -> Surface, Result
surface_4 = Surface(flatten([flip_3.Surface, flip_4.Surface, flip_5.Surface, flip_6.Surface, flip_2.Surface, flip.Surface]))
surface_5 = Surface(surface_4)
list_length_3 = ListLength(List=surface_5)
area_9 = Area(Geometry=surface_5)  # -> Area, Centroid
evaluate_surface_3 = EvaluateSurface(Surface=surface_5, Point=area_9.Centroid)  # -> Point, Normal, UDirection, VDirection, Frame

# ---- group: Check Your Normals!
vector_display_ex = VectorDisplayEx(Point=area_9.Centroid, Vector=evaluate_surface_3.Normal, Colour=RGB(0, 0, 0), Width=5)

# ----
populate_2d = Populate2D(Region={Plane=PlaneXY(-6, -151.125, 0), Size=Domain2(u=-88.5..88.5, v=-59.875..59.875)}, Count=list_length_3, Seed=1)
unit_z_3 = UnitZ(Factor=1)
orient_direction = OrientDirection(
    Geometry=surface_5,
    PointA=area_9.Centroid,
    DirectionA=evaluate_surface_3.Normal,
    PointB=populate_2d,
    DirectionB=unit_z_3)  # -> flatten(Geometry), Transform
area_10 = Area(Geometry=orient_direction.Geometry)  # -> Area, Centroid

# ---- group: Check Your Normals!
vector_display_ex_2 = VectorDisplayEx(Point=area_9.Centroid, Vector=evaluate_surface_3.Normal, Colour=RGB(0, 0, 0), Width=Slider(5, range=0..10))

# ----
srf_2 = Surface(flatten(item_2.Item))
sort_list_2 = SortList(Keys=area_10.Area, ValuesValuesA=orient_direction.Geometry)  # -> Keys, ValuesValuesA
edges = BrepEdges(Brep=sort_list_2.ValuesValuesA)  # -> Naked, Interior, NonManifold
area_11 = Area(Geometry=srf_2)  # -> Area, Centroid
join = JoinCurves(Curves=edges.Naked, Preserve=False)
topoly = CurveToPolyline(Curve=join, ToleranceDistance=0, ToleranceAngle=0, MinEdge="1", MaxEdge="1")  # -> Polyline, Segments
inscribecircle = InscribeCircle(Polylines=topoly.Polyline, Tolerance=10)
darc = DeconstructArc(Arc=inscribecircle)  # -> BasePlane, Radius, Angle
sort_list_3 = SortList(Keys=area_11.Area, ValuesValuesA=srf_2)  # -> Keys, graft(ValuesValuesA)
deplane = DeconstructPlane(Plane=darc.BasePlane)  # -> Origin, XAxis, YAxis, ZAxis
# OpenNest- aka Cut Sheets:
number_slider_2 = Slider(0.05, range=0..0.1)
sort_2 = SortList(Keys=join, ValuesA=join)  # -> Keys, reverse(ValuesA)
item_3 = ListItem(List=sort_2.ValuesA, Index=0, Wrap=True)
tree_statistics = TreeStatistics(Tree=item_3)  # -> Paths, Length, Count
tstat = TreeStatistics(Tree=sort_list_3.ValuesValuesA)  # -> Paths, Length, Count
series_2 = Series(Start=1, Step=1, Count=tree_statistics.Count)  # -> graft(Series)
evalsrf = EvaluateSurface(Surface=reparameterize(sort_list_3.ValuesValuesA), Point="0.5,0.5")  # -> Point, Normal, UDirection, VDirection, Frame
repeat = RepeatData(Data=panel, Length=tstat.Count)  # -> graft(Data)
series_3 = Series(Start=1, Step=1, Count=tstat.Count)  # -> graft(Series)
opennest = OpenNest(
    Sheets=material,
    Geo=flatten(item_3),
    Spacing=1,
    Placement=1,
    Tolerance=number_slider_2,
    Rotations=4,
    Iterations=1,
    Seed=1,
    Reset=True,
    Run=False)  # -> Sheets, graft(Geo), ID, Transform, IDS

# ---- group: Sheets
# Key:
# Inputs
curve = Curve(opennest.Sheets)

# ----
repeat_data = RepeatData(Data=panel, Length=tree_statistics.Count)  # -> graft(Data)

# ---- group: Flip Text *
deplane_2 = DeconstructPlane(Plane=evalsrf.Frame)  # -> Origin, XAxis, YAxis, ZAxis
rev_2 = Reverse(Vector=deplane_2.XAxis)
pl = ConstructPlane(Origin=deplane_2.Origin, XAxis=deplane_2.XAxis, YAxis=deplane_2.YAxis)

# ----
merge = Merge(Data1=repeat, Data2=series_3)
join_2 = TextJoin(Text=merge)
merge_2 = Merge(Data1=repeat_data, Data2=series_2)
size_of_text = Slider(3, range=0..10)
transform = Transform(Geometry=sort_list_2.ValuesValuesA, Transform=opennest.Transform)
curve_2 = Curve(opennest.Geo)
text_join = TextJoin(Text=merge_2)
brep_edges = BrepEdges(Brep=transform)  # -> Naked, Interior, NonManifold
match_tree = MatchTree(Tree=text_join, Guide=join_2)
text = Text(Location=pl, Text=join_2, Size=size_of_text, Bold=True, HorizontalAlignment=0, VerticalAlignment=0)  # -> flatten(Curves)

# ---- group: 3d Labels
curve_3 = Curve(text)

# ----
join_curves = JoinCurves(Curves=brep_edges.Naked, Preserve=False)
# Outputs
# Check!
cut = Curve(join_curves)
entwine = Entwine(Branch00=match_tree, Branch01=join_2, FlattenInputs=True)
topoly_2 = CurveToPolyline(Curve=join, ToleranceDistance=0, ToleranceAngle=0, MinEdge="1", MaxEdge="1")  # -> Polyline, Segments
flip_matrix_6 = FlipMatrix(Data=entwine)
inscribecircle_2 = InscribeCircle(Polylines=topoly_2.Polyline, Tolerance=10)
darc_2 = DeconstructArc(Arc=inscribecircle_2)  # -> BasePlane, Radius, Angle
text_2 = Text(Location=deplane.Origin, Text=text_join, Size=Slider(1.771, range=0..50))
deplane_3 = DeconstructPlane(Plane=darc_2.BasePlane)  # -> Origin, XAxis, YAxis, ZAxis
index = ItemIndex(List=item_3, Item=item_3)
transform_2 = Transform(Geometry=text_2, Transform=graft(opennest.Transform))

# ---- group: 2D Labels
curve_4 = Curve(transform_2)

# ----
list_length_4 = ListLength(List=curve_4)  # -> flatten(Length)
list_length_5 = ListLength(List=list_length_4)

# ---- group: IF these aren't = dont trust the numbering
panel_3 = Panel(list_length_5)
panel_4 = Panel(list_length)

# ----
text_3 = Text(Location=flatten(deplane_3.Origin), Text=index, Size=Slider(20, range=0..50))
transform_3 = Transform(Geometry=text_3, Transform=graft(opennest.Transform))
